# Dynamo graph readAnalyticalModel_python.dyn (Dynamo 0.7.5.3566)

select_model_elements = DSModelElementsSelection()  # 168 picked in the model
ID = Custom[Element.ID](Element_s=select_model_elements)  # Gets the ID(s) for a list of Revit elements (or a single element) - unlike the built-in Element.Id node, this node returns an actual Revit Element ID and *not* a number
python_script = Python(IN[0]=select_model_elements)
# ---------- python_script.python (30 lines) ----------
import clr
clr.AddReference('RevitAPI')
from Autodesk.Revit.DB import *
from Autodesk.Revit.DB import Structure

clr.AddReference("RevitServices")
import RevitServices
from RevitServices.Persistence import DocumentManager

clr.AddReference("RevitNodes")
import Revit
clr.ImportExtensions(Revit.GeometryConversion)

doc = DocumentManager.Instance.CurrentDBDocument
items = UnwrapElement(IN[0])
typelist = list()
mm = list()
for item in items:
	try: 
		typelist.append(doc.GetElement(item.Id))
		
		startPoint = (doc.GetElement(item.Id)).GetCurve().ToProtoType()
		

		mm.append(startPoint)
	except:
		#typelist.append(list())
		t="no"
		
OUT = mm
# ----------------------------------------
watch = Watch(python_script)
flatten = Flatten()
define = DynamoSAP.Definitions.SectionProp.Define()
fromLine = DynamoSAP.Structure.Frame.FromLine(python_script, define)
collector = DynamoSAP.Assembly.StructuralModel.Collector(fromLine)
boolean = BoolSelector(true)
toSAP = DynamoSAP.Assembly.Bake.ToSAP(collector, boolean)
