# Dynamo graph Frame testing.dyn (Dynamo 0.7.5.3370)

byCoordinates = Point.ByCoordinates()
code_block = CodeBlock { 3; }
byCoordinates_2 = Point.ByCoordinates(arg2=code_block)
define = DynamoSAP.Structure.SectionProp.Define()
fromEndPoints = DynamoSAP.Structure.Frame.FromEndPoints(byCoordinates, byCoordinates_2, define)
code_block_2 = CodeBlock { "Frame_loadp"; }
loadPatternTypeDropDown = LoadPatternTypeDropDown("LTYPE_DEAD")
setLoadPattern = DynamoSAP.Structure.LoadPattern.SetLoadPattern(code_block_2, loadPatternTypeDropDown)
code_block_3 = CodeBlock { 1; }
code_block_4 = CodeBlock { 4; }
code_block_5 = CodeBlock { 0.5; }
code_block_6 = CodeBlock { 10; }
pointLoadOnFrame = DynamoSAP.Structure.Load.PointLoadOnFrame(setLoadPattern, code_block_3, code_block_4, code_block_5, code_block_6)
setLoad = DynamoSAP.Structure.Frame.SetLoad(fromEndPoints, pointLoadOnFrame)
collector = DynamoSAP.Assembly.StructuralModel.Collector(setLoad)
decompose = DynamoSAP.Structure.Load.Decompose(pointLoadOnFrame)
displayLoads = DynamoSAP.Structure.Frame.DisplayLoads(setLoad)
