# Dynamo graph Sample_3a_RunAnalysis_ReadResults.dyn (Dynamo 0.7.5.3566)

# note: Set boolean to True to run the analysis on SAP
boolean = BoolSelector(true)
# note: Get the structural elements and definitions in the model
run = DynamoSAP.Analysis.Analysis.Run(boolean)
integer_slider = IntegerSlider(3, range=0..5)
# note: Select a Load Case or Load Pattern to get results and visualize them
getItemAtIndex = List.GetItemAtIndex(run.out1, integer_slider)
boolean_2 = BoolSelector(true)
# note: Get results for a specific load case or load pattern
getResults = DynamoSAP.Analysis.Analysis.GetResults(getItemAtIndex, boolean_2)
# note: Select which type of force/moment to view
forceTypes = ForceTypes("Moment33")
boolean_3 = BoolSelector(true)
double_slider = DoubleSlider(0.5, range=0..10)
# note: Visualize the results
visualizeResults = DynamoSAP.Analysis.Analysis.VisualizeResults(run.out0, getResults, forceTypes, boolean_3, double_slider)
# note: Use Structural Model.Decompose to preview the geometry of the structural members
decompose = DynamoSAP.Assembly.StructuralModel.Decompose(run.out0)
# note: Get the numeric values of the results
decomposeResults = DynamoSAP.Analysis.Analysis.DecomposeResults(run.out0, getResults, forceTypes)
watch = Watch(decomposeResults)
watch_2 = Watch(run.out1)
