# Dynamo graph Space_structure.dyn (Dynamo 0.7.6.3423)

code_block = CodeBlock { 5; }
code_block_2 = CodeBlock(n=code_block) { 0..#5..n; }
byCoordinates = Point.ByCoordinates(arg1=code_block_2)
randomList = Math.RandomList(code_block)
code_block_3 = CodeBlock { 5; }
code_block_4 = CodeBlock { 10; }
remapRange = Math.RemapRange(randomList, code_block_3, code_block_4)
code_block_5 = CodeBlock { 0; }
ofRepeatedItem = List.OfRepeatedItem(code_block_5, code_block)
code_block_6 = CodeBlock { 180; }
ofRepeatedItem_2 = List.OfRepeatedItem(code_block_6, code_block)
YAxis = Vector.YAxis()
ofRepeatedItem_3 = List.OfRepeatedItem(YAxis, code_block)
byCenterPointRadiusAngle = Arc.ByCenterPointRadiusAngle(byCoordinates, remapRange, ofRepeatedItem, ofRepeatedItem_2, ofRepeatedItem_3)
byLoft = PolySurface.ByLoft(byCenterPointRadiusAngle)
code_block_7 = CodeBlock { 10; }
code_block_8 = CodeBlock { 15; }
lunchbox_braced_grid_stucture_1d = Custom[LunchBox Braced Grid Stucture 1D](Surface=byLoft, U=code_block_7, V=code_block_8)  # Creates a 1D braced grid structure on a surface
define = DynamoSAP.Structure.SectionProp.Define()
fromLine = DynamoSAP.Structure.Frame.FromLine(lunchbox_braced_grid_stucture_1d.Centerlines_A, define)
watch_3d = Watch3D(fromLine)
code_block_9 = CodeBlock { "Space Structure pattern"; }
loadPatternTypeDropDown = LoadPatternTypeDropDown("LTYPE_DEAD")
code_block_10 = CodeBlock { 1; }
setLoadPattern = DynamoSAP.Structure.LoadPattern.SetLoadPattern(code_block_9, loadPatternTypeDropDown, code_block_10)
code_block_11 = CodeBlock { 1; }
code_block_12 = CodeBlock { 4; }
code_block_13 = CodeBlock { 0; }
code_block_14 = CodeBlock { 1; }
code_block_15 = CodeBlock { 10; }
distributedLoadOnFrame = DynamoSAP.Structure.Load.DistributedLoadOnFrame(setLoadPattern, code_block_11, code_block_12, code_block_13, code_block_14, code_block_15, code_block_15)
setLoad = DynamoSAP.Structure.Frame.SetLoad(fromLine, distributedLoadOnFrame)
fromLine_2 = DynamoSAP.Structure.Frame.FromLine(lunchbox_braced_grid_stucture_1d.Centerlines_B, define)
setLoad_2 = DynamoSAP.Structure.Frame.SetLoad(fromLine_2, distributedLoadOnFrame)
fromLine_3 = DynamoSAP.Structure.Frame.FromLine(lunchbox_braced_grid_stucture_1d.Centerlines_C, define)
create = List.Create(setLoad, setLoad_2, fromLine_3)
flatten = Flatten(create)
code_block_16 = CodeBlock { "Space structure LC"; }
code_block_17 = CodeBlock { 1.2; }
loadCaseTypeDropDown = LoadCaseTypeDropDown("CASE_LINEAR_STATIC")
setLoadCase = DynamoSAP.Structure.LoadCase.SetLoadCase(code_block_16, setLoadPattern, code_block_17, loadCaseTypeDropDown)
endPoint = Curve.EndPoint(lunchbox_braced_grid_stucture_1d.Centerlines_A)
startPoint = Curve.StartPoint(lunchbox_braced_grid_stucture_1d.Centerlines_A)
create_2 = List.Create(endPoint, startPoint)
flatten_2 = Flatten(create_2)
Z = Vector.Z(flatten_2)
python_script = Python(IN[0]=Z, IN[1]=flatten_2)
# ---------- python_script.python (15 lines) ----------
import clr
clr.AddReference('ProtoGeometry')
from Autodesk.DesignScript.Geometry import *


#The inputs to this node will be stored as a list in the IN variable.
dataEnteringNode = IN
pt=[]
for i in range(0,IN[0].Count,1):
 	if(round(IN[0][i],2)==0.0):
 		
 		pt.append(IN[1][i])

#Assign your output to the OUT variable
OUT = pt
# ----------------------------------------
pinned = DynamoSAP.Structure.Restraint.Pinned(python_script)
collector = DynamoSAP.Assembly.StructuralModel.Collector(flatten, setLoadPattern, setLoadCase, pinned)
code_block_18 = CodeBlock { 0.01; }
code_block_19 = CodeBlock { 0.1; }
displayLoads = DynamoSAP.Structure.Frame.DisplayLoads(flatten, code_block_9, code_block_18, arg4=code_block_19)
decompose = DynamoSAP.Structure.Frame.Decompose(flatten)
