# Dynamo graph portal_new version.dyn (Dynamo 0.7.6.3423)

code_block = CodeBlock { "Steel"; }
number = DoubleInput(4)
number_2 = DoubleInput(4)
integer_slider = IntegerSlider(5, range=0..100)
number_3 = DoubleInput(0)
double_slider = DoubleSlider(300, range=150..500)
double_slider_2 = DoubleSlider(500, range=150..500)
double_slider_3 = DoubleSlider(350, range=150..500)
xyzGrid = Custom[XyzGrid](x_count=number, y_count=number_2, z_count=integer_slider, x0=number_3, y0=number_3, z0=number_3, x_space=double_slider, y_space=double_slider_2, z_space=double_slider_3)  # This node represents an upgrade of the 0.6.3 XyzGrid node to 0.7.x
flatten = Flatten(xyzGrid)
formula = Formula("x*y;", x=number, y=number_2)
chop = List.Chop(flatten, formula)
transpose = List.Transpose(chop)
byPoints = PolyCurve.ByPoints(transpose)
explode = Geometry.Explode(byPoints)
# note: COLUMNS
flatten_2 = Flatten(explode)
startPoint = Curve.StartPoint(flatten_2)
endPoint = Curve.EndPoint(flatten_2)
define = DynamoSAP.Structure.SectionProp.Define()
# note: COLUMN FRAMES
fromEndPoints = DynamoSAP.Structure.Frame.FromEndPoints(startPoint, endPoint, define)
code_block_2 = CodeBlock { "Move_Load_Sample"; }
loadPatternTypeDropDown = LoadPatternTypeDropDown("LTYPE_MOVE")
number_4 = DoubleInput(0.75)
setLoadPattern = DynamoSAP.Structure.LoadPattern.SetLoadPattern(code_block_2, loadPatternTypeDropDown, number_4)
type_1_force_2_moment = DoubleInput(1)
load_direction_4_x_5_y_6_z = IntegerSlider(5, range=0..100)
code_block_3 = CodeBlock { 0.5; }
code_block_4 = CodeBlock { 100; }
pointLoadOnFrame = DynamoSAP.Structure.Load.PointLoadOnFrame(setLoadPattern, type_1_force_2_moment, load_direction_4_x_5_y_6_z, code_block_3, code_block_4)
# note: DIAGONAL FRAMES
setLoad = DynamoSAP.Structure.Frame.SetLoad(fromEndPoints, pointLoadOnFrame)
create = List.Create()
number_5 = DoubleInput(1)
formula_2 = Formula("z-1", z=integer_slider)
number_sequence = NumberSeq(number_5, formula_2, number_5, lacing=Longest)
getItemAtIndex = List.GetItemAtIndex(chop, number_sequence)
flatten_3 = Flatten(getItemAtIndex)
chop_2 = List.Chop(flatten_3, number)
chop_3 = List.Chop(chop_2, number_2)
byPoints_2 = PolyCurve.ByPoints(chop_3)
explode_2 = Geometry.Explode(byPoints_2)
flatten_4 = Flatten()
map = List.Map(explode_2, flatten_4)
number_6 = DoubleInput(0)
code_block_5 = CodeBlock(x=number, y=number_2) { x*y; }
number_sequence_2 = NumberSeq(number_6, formula_2, code_block_5, lacing=Longest)
number_7 = DoubleInput(1)
number_sequence_3 = NumberSeq(number_sequence_2, number, number_7, lacing=Longest)
number_sequence_4 = NumberSeq(number_sequence_3, number_2, number, lacing=Longest)
getItemAtIndex_2 = List.GetItemAtIndex(flatten_3, number_sequence_4)
byPoints_3 = PolyCurve.ByPoints(getItemAtIndex_2)
explode_3 = Geometry.Explode(byPoints_3)
map_2 = List.Map(explode_3, flatten_4)
combine = List.Combine(create, map, map_2)
# note: BEAMS
flatten_5 = Flatten(combine)
startPoint_2 = Curve.StartPoint(flatten_5)
endPoint_2 = Curve.EndPoint(flatten_5)
# note: BEAM FRAMES
fromEndPoints_2 = DynamoSAP.Structure.Frame.FromEndPoints(startPoint_2, endPoint_2, define)
code_block_6 = CodeBlock { "Dead_Load_Sample"; }
loadPatternTypeDropDown_2 = LoadPatternTypeDropDown("LTYPE_DEAD")
number_8 = DoubleInput(1.6)
# note: LOAD PATTERN
setLoadPattern_2 = DynamoSAP.Structure.LoadPattern.SetLoadPattern(code_block_6, loadPatternTypeDropDown_2, number_8)
load_direction_4_x_5_y_6_z_2 = IntegerSlider(6, range=0..100)
double_slider_4 = DoubleSlider(0, range=0..100)
double_slider_5 = DoubleSlider(1, range=0..100)
double_slider_6 = DoubleSlider(-15, range=-100..0)
code_block_7 = CodeBlock { "Global"; }
# note: LOADS
distributedLoadOnFrame = DynamoSAP.Structure.Load.DistributedLoadOnFrame(setLoadPattern_2, type_1_force_2_moment, load_direction_4_x_5_y_6_z_2, double_slider_4, double_slider_5, double_slider_6, double_slider_6, code_block_7)
setLoad_2 = DynamoSAP.Structure.Frame.SetLoad(fromEndPoints_2, distributedLoadOnFrame)
create_2 = List.Create()
number_9 = DoubleInput(5)
number_10 = DoubleInput(6)
number_11 = DoubleInput(9)
number_12 = DoubleInput(10)
create_3 = List.Create(number_9, number_10, number_11, number_12)
getItemAtIndex_3 = List.GetItemAtIndex(explode, create_3)
transpose_2 = List.Transpose(getItemAtIndex_3)
endPoint_3 = Curve.EndPoint(transpose_2)
number_13 = DoubleInput(1)
number_14 = DoubleInput(2)
number_sequence_5 = NumberSeq(number_13, number_14, number_13, lacing=Longest)
getItemAtIndex_4 = List.GetItemAtIndex(arg1=number_sequence_5)
map_3 = List.Map(endPoint_3, getItemAtIndex_4)
flatten_6 = Flatten(map_3)
startPoint_3 = Curve.StartPoint(transpose_2)
number_15 = DoubleInput(0)
number_16 = DoubleInput(2)
number_17 = DoubleInput(3)
number_sequence_6 = NumberSeq(number_15, number_16, number_17, lacing=Longest)
getItemAtIndex_5 = List.GetItemAtIndex(arg1=number_sequence_6)
map_4 = List.Map(startPoint_3, getItemAtIndex_5)
flatten_7 = Flatten(map_4)
combine_2 = List.Combine(create_2, flatten_6, flatten_7)
flatten_8 = Flatten(combine_2)
number_18 = DoubleInput(4)
chop_4 = List.Chop(flatten_8, number_18)
boolean = BoolSelector(true)
byPoints_4 = PolyCurve.ByPoints(chop_4, boolean)
explode_4 = Geometry.Explode(byPoints_4)
# note: CORE DIAGONALS
flatten_9 = Flatten(explode_4)
startPoint_4 = Curve.StartPoint(flatten_9)
endPoint_4 = Curve.EndPoint(flatten_9)
fromEndPoints_3 = DynamoSAP.Structure.Frame.FromEndPoints(startPoint_4, endPoint_4, define)
boolean_2 = BoolSelector(true)
# note: RELEASE
set = DynamoSAP.Structure.Release.Set(arg9=boolean_2, arg11=boolean_2)
setReleases = DynamoSAP.Structure.Frame.SetReleases(fromEndPoints_3, set)
create_4 = List.Create(setLoad, setLoad_2, setReleases)
flatten_10 = Flatten(create_4)
code_block_8 = CodeBlock { "Live_Load_Sample"; }
loadPatternTypeDropDown_3 = LoadPatternTypeDropDown("LTYPE_LIVE")
number_19 = DoubleInput(1.25)
setLoadPattern_3 = DynamoSAP.Structure.LoadPattern.SetLoadPattern(code_block_8, loadPatternTypeDropDown_3, number_19)
create_5 = List.Create(setLoadPattern_3, setLoadPattern_2, setLoadPattern)
flatten_11 = Flatten(create_5)
code_block_9 = CodeBlock { "Load_Case_Sample"; }
number_20 = DoubleInput(1.2)
number_21 = DoubleInput(1.3)
number_22 = DoubleInput(1.2)
# note: LOAD CASE
create_6 = List.Create(number_20, number_21, number_22)
loadCaseTypeDropDown = LoadCaseTypeDropDown("CASE_LINEAR_STATIC")
setLoadCase = DynamoSAP.Structure.LoadCase.SetLoadCase(code_block_9, create_5, create_6, loadCaseTypeDropDown)
create_7 = List.Create(setLoadCase)
flatten_12 = Flatten(create_7)
number_23 = DoubleInput(0)
getItemAtIndex_6 = List.GetItemAtIndex(chop, number_23)
# note: RESTRAINTS
pinned = DynamoSAP.Structure.Restraint.Pinned(getItemAtIndex_6)
# note: COLLECTOR
collector = DynamoSAP.Assembly.StructuralModel.Collector(flatten_10, flatten_11, flatten_12, pinned)
boolean_3 = BoolSelector(false)
toSAP = DynamoSAP.Assembly.Bake.ToSAP(collector, boolean_3)
decompose = DynamoSAP.Assembly.StructuralModel.Decompose(toSAP)
integer_slider_2 = IntegerSlider(1, range=0..100)
getItemAtIndex_7 = List.GetItemAtIndex(decompose.out1, integer_slider_2)
watch = Watch(getItemAtIndex_7)
sections = DynamoSAP.Structure.SectionProp.Sections()
decompose_2 = DynamoSAP.Structure.Frame.Decompose(fromEndPoints)
decompose_3 = DynamoSAP.Structure.LoadPattern.Decompose(getItemAtIndex_7)
code_block_10 = CodeBlock { 3; }
boolean_4 = BoolSelector(true)
code_block_11 = CodeBlock { 20; }
displayLoads = DynamoSAP.Structure.Frame.DisplayLoads(setLoad_2, decompose_3, code_block_10, boolean_4, code_block_11)
decompose_4 = DynamoSAP.Structure.Frame.Decompose(setLoad)
boolean_5 = BoolSelector(true)
run = DynamoSAP.Analysis.Analysis.Run(boolean_5)
integer_slider_3 = IntegerSlider(1, range=0..100)
getItemAtIndex_8 = List.GetItemAtIndex(run.out2, integer_slider_3)
boolean_6 = BoolSelector(true)
getResults = DynamoSAP.Analysis.Analysis.GetResults(getItemAtIndex_8, boolean_6)
forceTypeDropDown = ForceTypeDropdown("Torsion")
decomposeResults = DynamoSAP.Analysis.Analysis.DecomposeResults(run.out0, getResults, forceTypeDropDown)
fromLine = DynamoSAP.Structure.Frame.FromLine()
run_2 = DynamoSAP.Analysis.Analysis.Run()
decompose_5 = DynamoSAP.Assembly.StructuralModel.Decompose(run.out0)
baseCurve = DynamoSAP.Structure.Frame.BaseCurve(decompose_5)
code_block_12 = CodeBlock { 4000; }
visualizeResults = DynamoSAP.Analysis.Analysis.VisualizeResults(run.out0, getResults, forceTypeDropDown, code_block_12, boolean_6)
code_block_13 = CodeBlock { 1; }
getItemAtIndex_9 = List.GetItemAtIndex(visualizeResults, code_block_13)
code_block_14 = CodeBlock { 1; }
getItemAtIndex_10 = List.GetItemAtIndex(getItemAtIndex_9, code_block_14)
