# Dynamo graph simpletest.dyn (Dynamo 0.7.2.2921)

byCoordinates = Point.ByCoordinates()
double_slider = DoubleSlider(47.119, range=0..100)
double_slider_2 = DoubleSlider(33.331, range=0..100)
byCoordinates_2 = Point.ByCoordinates(double_slider, double_slider_2)
code_block = CodeBlock { "test"; }
integer_slider = IntegerSlider(0, range=0..100)
double_slider_3 = DoubleSlider(59.484, range=0..100)
fromEndPoints = DynamoSAP.Structure.Frame.FromEndPoints(byCoordinates, byCoordinates_2, code_block, code_block, integer_slider, double_slider_3)
baseCurve = DynamoSAP.Structure.Frame.BaseCurve(fromEndPoints)
rotation = DynamoSAP.Structure.Frame.Rotation(fromEndPoints)
toString = ToString(fromEndPoints)
setLoadPattern = DynamoSAP.Analysis.LoadPattern.SetLoadPattern(code_block, double_slider_3)
integer_slider_2 = IntegerSlider(28, range=0..100)
double_slider_4 = DoubleSlider(28.379, range=0..100)
code_block_2 = CodeBlock { "myload"; }
boolean = BoolSelector(true)
pointLoadOnFrame = DynamoSAP.Analysis.Load.PointLoadOnFrame(fromEndPoints, setLoadPattern, integer_slider_2, integer_slider_2, double_slider_4, double_slider_4, code_block_2, boolean, boolean)
watch = Watch(pointLoadOnFrame)
distributedLoadOnFrame = DynamoSAP.Analysis.Load.DistributedLoadOnFrame()
distance2 = DynamoSAP.Analysis.Load.Distance2(pointLoadOnFrame)
watch_2 = Watch(distance2)
distance1 = DynamoSAP.Analysis.Load.Distance1(pointLoadOnFrame)
watch_3 = Watch(distance1)
